# Grasshopper definition 3Dplant.gh (Grasshopper 0.9.76)
# plug-ins: Firefly.Core

z_value = Slider(119, range=0..180)
z_division = Slider(6, range=0..10)
open_port = OpenClosePort(OpenClosePort=Toggle(True), PortNumber="16", BaudRate=115200)
pt = ConstructPoint(XCoordinate=0, YCoordinate=0, ZCoordinate=0)
pt_2 = ConstructPoint(XCoordinate=0, YCoordinate=0, ZCoordinate=z_value)
panel = Panel(open_port)
ports_available = COMPortsAvailable()
panel_2 = Panel(ports_available)
ln = Line(StartPoint=pt, EndPoint=pt_2)
timer = Timer(TimerInterval=100, Target=uno_read)
divide = DivideCurve(Curve=ln, Count=z_division, Kinks=False)  # -> Points, Tangents, Parameters
uno_read = UnoRead(StartReadingValues=Toggle(True), PortNumber="16")  # -> AnalogPin0, AnalogPin1, AnalogPin2, AnalogPin3, AnalogPin4, AnalogPin5, DigitalPin2, DigitalPin4, DigitalPin7, StatusMessage
multiplication = Multiplication(A=uno_read.AnalogPin0, B=0.8)
panel_3 = Panel(multiplication)
val = Slider(47, range=0..50)
panel_4 = Panel(uno_read.AnalogPin0)
division = Division(A=uno_read.AnalogPin0, B="20")
panel_5 = Panel(uno_read.AnalogPin4)
panel_6 = Panel(division)
remap = RemapNumbers(Source=Domain(0, 1), Target=Domain(0, 1))  # -> Mapped, Clipped
val_2 = Slider(36, range=0..50)
val_3 = Slider(40, range=0..50)
val_4 = Slider(33, range=0..50)
val_5 = Slider(28, range=0..50)
division_2 = Division(A=panel_5, B="15")
division_3 = Division(A=panel_5, B="80")
panel_7 = Panel(division_2)
panel_8 = Panel(division_3)
panel_9 = Panel(["50", val_3, panel_6, val_2, panel_7, val_4, val_5, "25"])
num_segments = Slider(9, range=3..15)
polygon = Polygon(Plane=divide.Points, Radius=panel_9, Segments=panel_8, FilletRadius=0)  # -> Polygon, Length
loft = Loft(Curves=polygon.Polygon, Options={Adjust=False, Closed=False, LoftEnds=0, LoftSimp=0, LoftType=0, Rebuild=10, Refit=0.01})
cap = CapHoles(Brep=loft)
