# Grasshopper definition 3Dplant_final.gh (Grasshopper 0.9.76)
# plug-ins: Firefly.Core

open_port = OpenClosePort(OpenClosePort=Toggle(True), PortNumber="8", BaudRate=115200)
ports_available = COMPortsAvailable()
open_port_2 = OpenClosePort(OpenClosePort=Toggle(True), PortNumber="8", BaudRate=115200)
panel = Panel(ports_available)
panel_2 = Panel(open_port)
panel_3 = Panel(open_port_2)
timer = Timer(TimerInterval=1000, Target=uno_write)
uno_write = UnoWrite(
    StartWritingValues=Toggle(True),
    DigitalPin13=0,
    DigitalPin12=0,
    DigitalPin11=0,
    DigitalPin10=0,
    DigitalPin9=0,
    DigitalPin8=0,
    DigitalPin6=0,
    DigitalPin5=0,
    DigitalPin3=0,
    PortNumber=panel_2)  # -> ArduinoOutput, StatusMessage
timer_2 = Timer(TimerInterval=20, Target=uno_read)
uno_read = UnoRead(StartReadingValues=Toggle(True), PortNumber="8")  # -> AnalogPin0, AnalogPin1, AnalogPin2, AnalogPin3, AnalogPin4, AnalogPin5, DigitalPin2, DigitalPin4, DigitalPin7, StatusMessage
a4_temp = Panel(uno_read.AnalogPin4)
a3_pot2 = Panel(uno_read.AnalogPin3)
a5_sonar = Panel(uno_read.AnalogPin5)
a2_pot1 = Panel(uno_read.AnalogPin2)
a0_light_1 = Panel(uno_read.AnalogPin0)
a1_light_2 = Panel(uno_read.AnalogPin1)
remap = RemapNumbers(Value=a2_pot1, Source="0.0 To 1023.0", Target="100 To 160")  # -> Mapped, Clipped
int = Integer(remap.Mapped)
remap_2 = RemapNumbers(Value=a5_sonar, Source="0.0 To 600.0", Target="20 To 40")  # -> Mapped, Clipped
panel_4 = Panel(int)
remap_3 = RemapNumbers(Value=a4_temp, Source="0.0 To 1023.0", Target="35 To 45")  # -> Mapped, Clipped
z_high = Slider(131, range=0..180)
remap_4 = RemapNumbers(Value=a0_light_1, Source="0.0 To 1023.0", Target="30 To 45")  # -> Mapped, Clipped
remap_5 = RemapNumbers(Value=a1_light_2, Source="0.0 To 1023.0", Target="30 To 45")  # -> Mapped, Clipped
remap_6 = RemapNumbers(Value=a2_pot1, Source="600.0 To 1023.0", Target="20 To 30")  # -> Mapped, Clipped
remap_7 = RemapNumbers(Value=a3_pot2, Source="0.0 To 1023.0", Target="30 To 45")  # -> Mapped, Clipped
int_2 = Integer(remap_2.Mapped)
int_3 = Integer(remap_3.Mapped)
int_4 = Integer(remap_4.Mapped)
z_division = Slider(9, range=0..10)
top = Slider(47, range=20..100)
pt = ConstructPoint(XCoordinate=0, YCoordinate=0, ZCoordinate=0)
base = Slider(47, range=20..100)
pt_2 = ConstructPoint(XCoordinate=0, YCoordinate=0, ZCoordinate=panel_4)
base_2 = Slider(47, range=20..100)
panel_5 = Panel(int_2)
panel_6 = Panel(int_3)
panel_7 = Panel(remap_7.Mapped)
panel_8 = Panel(remap_6.Mapped)
panel_9 = Panel(int_4)
panel_10 = Panel(remap_5.Mapped)
ln = Line(StartPoint=pt, EndPoint=pt_2)
divide = DivideCurve(Curve=ln, Count=z_division, Kinks=False)  # -> Points, Tangents, Parameters
panel_11 = Panel([base, base_2, panel_9, panel_10, panel_8, panel_7, panel_6, panel_5, top])
remap_8 = RemapNumbers(Value=a3_pot2, Source="0.0 To 1023.0", Target="4 To 24")  # -> Mapped, Clipped
int_5 = Integer(remap_8.Mapped)
number_of_segments = Panel(int_5)
num_segments = Slider(24, range=1..90)
polygon = Polygon(Plane=divide.Points, Radius=panel_11, Segments=number_of_segments, FilletRadius=0)  # -> Polygon, Length
line = Line(Line((0, 0, 0), (0, 0, 165)))
rotax = RotateAxis(Angle=num_segments, Axis=line)  # -> Geometry, Transform
loft = Loft(Curves=polygon.Polygon, Options={Adjust=False, Closed=False, LoftEnds=0, LoftSimp=0, LoftType=0, Rebuild=10, Refit=0.01})
cap = CapHoles(Brep=loft)
num_segments_2 = Slider(2.182, range=1.1..3)
a1 = Panel(uno_read.AnalogPin1)
a0 = Panel(uno_read.AnalogPin0)
a5 = Panel(uno_read.AnalogPin5)
a2 = Panel(uno_read.AnalogPin2)
a3 = Panel(uno_read.AnalogPin3)
a4 = Panel(uno_read.AnalogPin4)
remap_9 = RemapNumbers(Value=a1, Source="0.0 To 1023.0", Target="3 To 57")  # -> Mapped, Clipped
remap_10 = RemapNumbers(Value=a0, Source="0.0 To 1023.0", Target="20 To 200")  # -> Mapped, Clipped
remap_11 = RemapNumbers(Value=a5, Source="0.0 To 600.0", Target="70 To 80")  # -> Mapped, Clipped
remap_12 = RemapNumbers(Value=a2, Source="0.0 To 1023.0", Target="3 To 100")  # -> Mapped, Clipped
remap_13 = RemapNumbers(Value=a3, Source="0.0 To 1023.0", Target="40 To 80")  # -> Mapped, Clipped
remap_14 = RemapNumbers(Value=a4, Source="20.0 To 50.0", Target="50 To 100")  # -> Mapped, Clipped
int_6 = Integer(remap_9.Mapped)
int_7 = Integer(remap_10.Mapped)
int_8 = Integer(remap_11.Mapped)
int_9 = Integer(remap_12.Mapped)
int_10 = Integer(remap_13.Mapped)
int_11 = Integer(remap_14.Mapped)
Z = UnitZ(Factor=int_6)
crv = Curve(<curve referenced from the Rhino model>)
Z_2 = UnitZ(Factor=int_7)
Z_3 = UnitZ(Factor=int_8)
Z_4 = UnitZ(Factor=int_9)
Z_5 = UnitZ(Factor=int_10)
Z_6 = UnitZ(Factor=int_11)
crv_2 = Curve(<curve referenced from the Rhino model>)
crv_3 = Curve(<curve referenced from the Rhino model>)
crv_4 = Curve(<curve referenced from the Rhino model>)
crv_5 = Curve(<curve referenced from the Rhino model>)
crv_6 = Curve(<curve referenced from the Rhino model>)
extr = Extrude(Base=crv, Direction=Z)
extr_2 = Extrude(Base=crv_2, Direction=Z_2)
extr_3 = Extrude(Base=crv_3, Direction=Z_3)
extr_4 = Extrude(Base=crv_4, Direction=Z_4)
extr_5 = Extrude(Base=crv_5, Direction=Z_5)
extr_6 = Extrude(Base=crv_6, Direction=Z_6)
