# Grasshopper definition 3Dplant_folle.gh (Grasshopper 0.9.76)
# plug-ins: Firefly.Core

open_port = OpenClosePort(OpenClosePort=Toggle(True), PortNumber="8", BaudRate=115200)
ports_available = COMPortsAvailable()
open_port_2 = OpenClosePort(OpenClosePort=Toggle(True), PortNumber="8", BaudRate=115200)
panel = Panel(ports_available)
panel_2 = Panel(open_port)
panel_3 = Panel(open_port_2)
timer = Timer(TimerInterval=1000, Target=uno_write)
uno_write = UnoWrite(
    StartWritingValues=Toggle(True),
    DigitalPin13=0,
    DigitalPin12=0,
    DigitalPin11=0,
    DigitalPin10=0,
    DigitalPin9=0,
    DigitalPin8=0,
    DigitalPin6=0,
    DigitalPin5=0,
    DigitalPin3=0,
    PortNumber=panel_2)  # -> ArduinoOutput, StatusMessage
timer_2 = Timer(TimerInterval=20, Target=uno_read)
uno_read = UnoRead(StartReadingValues=Toggle(True), PortNumber="8")  # -> AnalogPin0, AnalogPin1, AnalogPin2, AnalogPin3, AnalogPin4, AnalogPin5, DigitalPin2, DigitalPin4, DigitalPin7, StatusMessage
top = Slider(275, range=0..1023)
div = DivideDomain(Domain=top, Count="4")
z_high = Slider(131, range=0..180)
panel_4 = Panel(div)
a4_temp = Panel(uno_read.AnalogPin4)
a3_pot2 = Panel(uno_read.AnalogPin3)
a5_sonar = Panel(uno_read.AnalogPin5)
a2_pot1 = Panel(uno_read.AnalogPin2)
a0_light_1 = Panel(uno_read.AnalogPin0)
a1_light_2 = Panel(uno_read.AnalogPin1)
int = Integer()
partition = PartitionList(Size=[3, 2])
remap = RemapNumbers(Value=z_high, Source="0.0 To 1023.0", Target="100 To 160")  # -> Mapped, Clipped
split = SplitList(List=panel_4, Index="2")  # -> ListA, ListB
int_2 = Integer(remap.Mapped)
panel_5 = Panel(split.ListA)
panel_6 = Panel(split.ListB)
remap_2 = RemapNumbers(Value=a5_sonar, Source="0.0 To 600.0", Target="20 To 40")  # -> Mapped, Clipped
panel_7 = Panel(int_2)
remap_3 = RemapNumbers(Value=a4_temp, Source="0.0 To 1023.0", Target="35 To 45")  # -> Mapped, Clipped
remap_4 = RemapNumbers(Value=a0_light_1, Source="0.0 To 1023.0", Target="30 To 45")  # -> Mapped, Clipped
remap_5 = RemapNumbers(Value=a1_light_2, Source="0.0 To 1023.0", Target="30 To 45")  # -> Mapped, Clipped
remap_6 = RemapNumbers(Value=a2_pot1, Source="600.0 To 1023.0", Target="20 To 30")  # -> Mapped, Clipped
remap_7 = RemapNumbers(Value=a3_pot2, Source="0.0 To 1023.0", Target="30 To 45")  # -> Mapped, Clipped
int_3 = Integer(remap_2.Mapped)
int_4 = Integer(remap_3.Mapped)
int_5 = Integer(remap_4.Mapped)
z_division = Slider(4, range=0..10)
pt = ConstructPoint(XCoordinate=0, YCoordinate=0, ZCoordinate=0)
pt_2 = ConstructPoint(XCoordinate=0, YCoordinate=0, ZCoordinate=panel_7)
panel_8 = Panel(int_3)
split_2 = SplitList(List=panel_5, Index="1")  # -> ListA, ListB
panel_9 = Panel(int_4)
panel_10 = Panel(remap_7.Mapped)
panel_11 = Panel(remap_6.Mapped)
panel_12 = Panel(int_5)
panel_13 = Panel(remap_5.Mapped)
split_3 = SplitList(List=panel_6, Index="1")  # -> ListA, ListB
ln = Line(StartPoint=pt, EndPoint=pt_2)
base = Slider(37, range=20..100)
base_2 = Slider(41, range=20..100)
panel_14 = Panel(split_2.ListA)
panel_15 = Panel(split_2.ListB)
base_3 = Slider(85, range=20..100)
panel_16 = Panel(split_3.ListA)
panel_17 = Panel(split_3.ListB)
top_2 = Slider(1023, range=0..1023)
divide = DivideCurve(Curve=ln, Count=z_division, Kinks=False)  # -> Points, Tangents, Parameters
panel_18 = Panel([base, base_2, panel_13, panel_10])
bnd = Bounds()
partition_2 = PartitionList(List="0.0 To 1023.0", Size="4")
remap_8 = RemapNumbers(Value=top_2, Source="250.0 To 1023.0", Target="250.0 To 500.0")  # -> Mapped, Clipped
remap_9 = RemapNumbers(Value=top_2, Source="0.0 To 1023.0", Target="0.0 To 250.0")  # -> Mapped, Clipped
num_segments = Slider(6, range=1..90)
dom = ConstructDomain(DomainStart=0, DomainEnd=1)
panel_19 = Panel(partition_2)
int_6 = Integer(remap_8.Mapped)
remap_10 = RemapNumbers(Value=panel_14, Source="200 To 250", Target="1 To 1")  # -> Mapped, Clipped
int_7 = Integer(remap_9.Mapped)
dedomain = DeconstructDomain()  # -> Start, End
panel_20 = Panel(int_6)
panel_21 = Panel(int_7)
int_8 = Integer(remap_10.Mapped)
panel_22 = Panel(int_8)
remap_11 = RemapNumbers(Source="0.0 To 1023.0", Target="4 To 24")  # -> Mapped, Clipped
panel_23 = Panel(a2_pot1)
int_9 = Integer(remap_11.Mapped)
remap_12 = RemapNumbers(Value=panel_23, Source="0.0 To 1023.0", Target="2")  # -> Mapped, Clipped
number_of_segments = Panel(int_9)
remap_13 = RemapNumbers(Value=panel_20, Source="250.0 To 500.0", Target="6 To 6")  # -> Mapped, Clipped
remap_14 = RemapNumbers(Value=panel_21, Source="0.0 To 250.0", Target="1 To 1")  # -> Mapped, Clipped
int_10 = Integer(remap_12.Mapped)
num_segments_2 = Slider(24, range=1..90)
int_11 = Integer(remap_13.Mapped)
number_slider = Slider(4, range=0..30)
int_12 = Integer(remap_14.Mapped)
panel_24 = Panel(int_10)
panel_25 = Panel(int_11)
panel_26 = Panel(int_12)
polygon = Polygon(Plane=divide.Points, Radius=panel_18, Segments=num_segments, FilletRadius=0)  # -> Polygon, Length
line = Line(Line((0, 0, 0), (0, 0, 165)))
addition = Addition(A=Slider(4, range=0..30), B=Slider(1, range=0..30))
rotax = RotateAxis(Angle=num_segments_2, Axis=line)  # -> Geometry, Transform
series = Series(Start=0, Step=Slider(13, range=0..30), Count=addition)
number_of_segments_2 = Panel(polygon.Polygon)
line_2 = Line(Line((0, 0, 0), (0, 0, 165)))
number_of_segments_3 = Panel(series)
rotax_2 = RotateAxis(Geometry=polygon.Polygon, Angle=series, Axis=line_2)  # -> Geometry, Transform
num_segments_3 = Slider(2.182, range=1.1..3)
loft = Loft(
    Curves=rotax_2.Geometry,
    Options={Adjust=False, Closed=False, LoftEnds=0, LoftSimp=0, LoftType=0, Rebuild=10, Refit=0.01})
cap = CapHoles(Brep=loft)
a1 = Panel(uno_read.AnalogPin1)
a0 = Panel(uno_read.AnalogPin0)
a5 = Panel(uno_read.AnalogPin5)
a2 = Panel(uno_read.AnalogPin2)
a3 = Panel(uno_read.AnalogPin3)
a4 = Panel(uno_read.AnalogPin4)
remap_15 = RemapNumbers(Value=a1, Source="0.0 To 1023.0", Target="3 To 57")  # -> Mapped, Clipped
remap_16 = RemapNumbers(Value=a0, Source="0.0 To 1023.0", Target="20 To 200")  # -> Mapped, Clipped
remap_17 = RemapNumbers(Value=a5, Source="0.0 To 600.0", Target="70 To 80")  # -> Mapped, Clipped
remap_18 = RemapNumbers(Value=a2, Source="0.0 To 1023.0", Target="3 To 100")  # -> Mapped, Clipped
remap_19 = RemapNumbers(Value=a3, Source="0.0 To 1023.0", Target="40 To 80")  # -> Mapped, Clipped
remap_20 = RemapNumbers(Value=a4, Source="20.0 To 50.0", Target="50 To 100")  # -> Mapped, Clipped
int_13 = Integer(remap_15.Mapped)
int_14 = Integer(remap_16.Mapped)
int_15 = Integer(remap_17.Mapped)
int_16 = Integer(remap_18.Mapped)
int_17 = Integer(remap_19.Mapped)
int_18 = Integer(remap_20.Mapped)
Z = UnitZ(Factor=int_13)
crv = Curve(<curve referenced from the Rhino model>)
Z_2 = UnitZ(Factor=int_14)
Z_3 = UnitZ(Factor=int_15)
Z_4 = UnitZ(Factor=int_16)
Z_5 = UnitZ(Factor=int_17)
Z_6 = UnitZ(Factor=int_18)
crv_2 = Curve(<curve referenced from the Rhino model>)
crv_3 = Curve(<curve referenced from the Rhino model>)
crv_4 = Curve(<curve referenced from the Rhino model>)
crv_5 = Curve(<curve referenced from the Rhino model>)
crv_6 = Curve(<curve referenced from the Rhino model>)
extr = Extrude(Base=crv, Direction=Z)
extr_2 = Extrude(Base=crv_2, Direction=Z_2)
extr_3 = Extrude(Base=crv_3, Direction=Z_3)
extr_4 = Extrude(Base=crv_4, Direction=Z_4)
extr_5 = Extrude(Base=crv_5, Direction=Z_5)
extr_6 = Extrude(Base=crv_6, Direction=Z_6)
